# Grasshopper definition 011_WICKERSON_CHRISTEV.gh (Grasshopper 1.0.7)
# plug-ins: Bifocals

number_slider = Slider(5, range=0..10)
# Wickerson's Favorite .gh Scripts
# from WICKERSON/CHRISTEV
# PARAMETRIC PATTERN ROTATION
point = Point([Point(-3.252418605, 6.175534103, 0), Point(-2.628482246, 0.6004819913, 1.946825677), Point(-7.537709692, 0.6932393677, 0), Point(-8.22371449, 5.653620836, 0), Point(-5.637619833, 2.400923425, 0)])
hexagonal = Hexagonal(Plane=PlaneXY(0, 0, 0), Size=1, ExtentX=number_slider, ExtentY=number_slider)  # -> Cells, Points
rotate = Rotate(Geometry=hexagonal.Cells, Angle=1.570796327, Plane=PlaneXY(0, 0, 0))  # -> Geometry, Transform
explode = Explode(Curve=rotate.Geometry, Recursive=True)  # -> Segments, Vertices
list_item = ListItem(List=explode.Segments, Index="1", Wrap=True)
list_item_2 = ListItem(List=explode.Segments, Index="4", Wrap=True)
number_slider_2 = Slider(1, range=0..10)
divide_curve = DivideCurve(Curve=list_item, Count="2", Kinks=False)  # -> Points, Tangents, Parameters
divide_curve_2 = DivideCurve(Curve=list_item_2, Count="2", Kinks=False)  # -> Points, Tangents, Parameters
list_item_3 = ListItem(List=explode.Vertices, Index="0", Wrap=True)  # -> Item, Item1, Item2, Item3
list_item_4 = ListItem(List=divide_curve.Points, Index=number_slider_2, Wrap=True)
list_item_5 = ListItem(List=divide_curve_2.Points, Index=number_slider_2, Wrap=True)
list_item_6 = ListItem(List=explode.Vertices, Index="1", Wrap=True)  # -> Item, Item1, Item2, Item3
line = Line(StartPoint=list_item_4, EndPoint=list_item_5)
line_2 = Line(StartPoint=list_item_3.Item, EndPoint=list_item_6.Item2)
curve_curve = CurveCurve(CurveA=line, CurveB=line_2)  # -> Points, ParamsA, ParamsB
distance = Distance(PointA=flatten(curve_curve.Points), PointB=point)
construct_domain = ConstructDomain(DomainStart=Slider(0.02, range=0.02..100), DomainEnd=Slider(0.8, range=0..0.8))
bounds = Bounds(Numbers=distance)
remap_numbers = RemapNumbers(Value=graft(distance), Source=bounds, Target=construct_domain)  # -> Mapped, Clipped
vector_2pt = Vector2Pt(PointA=curve_curve.Points, PointB=list_item_4, Unitize=False)  # -> Vector, Length
amplitude = Amplitude(Vector=vector_2pt.Vector, Amplitude=remap_numbers.Mapped)
move = Move(Geometry=curve_curve.Points, Motion=amplitude)  # -> Geometry, Transform
_4point_surface = _4PointSurface(CornerA=move.Geometry, CornerB=list_item_6.Item2, CornerC=list_item_6.Item1, CornerD=list_item_4)
_4point_surface_2 = _4PointSurface(CornerA=move.Geometry, CornerB=list_item_3.Item, CornerC=list_item_6.Item, CornerD=list_item_4)
pi = Pi(Factor=1)
brep_join = BrepJoin(Breps=[_4point_surface, _4point_surface_2])  # -> Breps, Closed
rotate_2 = Rotate(Geometry=brep_join.Breps, Angle=pi, Plane=curve_curve.Points)  # -> Geometry, Transform
brep_join_2 = BrepJoin(Breps=[rotate_2.Geometry, brep_join.Breps])  # -> Breps, Closed
