# Grasshopper definition 012_WICKERSON_CHRISTEV.gh (Grasshopper 1.0.7)
# plug-ins: Bifocals

number_slider = Slider(9, range=0..20)
# from WICKERSON/CHRISTEV
# PARAMETRIC PATTERN SURFACE
construct_domain = ConstructDomain(DomainStart=0, DomainEnd=Slider(100, range=0..100))
construct_domain_2 = ConstructDomain(DomainStart=0, DomainEnd=Slider(100, range=0..100))
range = Range(Domain=construct_domain, Steps=number_slider)
range_2 = Range(Domain=construct_domain_2, Steps=number_slider)
# Wickerson's Favorite .gh Scripts
number_slider_2 = Slider(63, range=0..100)
graph_mapper = GraphMapper(
    range,
    x0=0,
    x1=1,
    y0=0,
    y1=1,
    container_name="Sine Summation",
    Equation0_px=[0.2997187376, 0.3],
    Equation0_py=[0.2740840912, 0.3],
    Equation1_px=[0.6966772676, 0.9],
    Equation1_py=[0.1513220668, 0.5])
graph_mapper_2 = GraphMapper(
    range,
    x0=0,
    x1=1,
    y0=0,
    y1=1,
    container_name="Sine Summation",
    Equation0_px=[0.2875808775, 0.01788686961],
    Equation0_py=[0.5703337193, 0.08610510826],
    Equation1_px=[0.6893692613, 1],
    Equation1_py=[0.01108407974, 1])
cross_reference = CrossReference(ListListA=range_2, ListListB=range_2, CrossMode=1)  # -> ListListA, ListListB
expression = Expression(u=number_slider, Expression="u+1")
cross_reference_2 = CrossReference(ListListA=graph_mapper, ListListB=graph_mapper_2, CrossMode=1)  # -> ListListA, ListListB
multiplication = Multiplication(A=cross_reference_2.ListListA, B=cross_reference_2.ListListB)
multiplication_2 = Multiplication(A=number_slider_2, B=multiplication)
construct_point = ConstructPoint(XCoordinate=cross_reference.ListListA, YCoordinate=cross_reference.ListListB, ZCoordinate=multiplication_2)
surface_from_points = SurfaceFromPoints(Points=flatten(construct_point), UCount=expression, Interpolate=False)
# Download MeshFromPoints component!!!
number_slider_3 = Slider(10, range=0..100)
number_slider_4 = Slider(0.17, range=0..1)
divide_domain² = DivideDomain²(Domain=surface_from_points, UCount=number_slider_3, VCount=number_slider_3)
expression_2 = Expression(x=number_slider_4, Expression="1-x")
expression_3 = Expression(x=Slider(0.207, range=0..1), Expression="1-x")
isotrim = Isotrim(Surface=surface_from_points, Domain=divide_domain²)
construct_domain² = ConstructDomain²(UMin=number_slider_4, UMax=expression_2, VMin=number_slider_4, VMax=expression_2)
isotrim_2 = Isotrim(Surface=reparameterize(isotrim), Domain=construct_domain²)  # -> graft(Surface)
project = Project(Geometry=isotrim_2, Plane=PlaneXY(0, 0, 0))  # -> Geometry, Transform
loft = Loft(
    Curves=[isotrim_2, project.Geometry],
    Options={Adjust=False, Closed=False, LoftEnds=0, LoftSimp=0, LoftType=0, Rebuild=10, Refit=0.01})
brep_join = BrepJoin(Breps=[project.Geometry, loft, isotrim_2])  # -> Breps, Closed
