# Grasshopper definition 013_WICKERSON.gh (Grasshopper 1.0.7)

# Range in Set/Sequence
# Points
# Sine and Cosine
# Spline instead of Line
number_slider = Slider(100, range=0..100)
# Wickerson's Favorite .gh Scripts
# from WICKERSON
# HELIX
number_slider_2 = Slider(14, range=0..100)
range = Range(Domain=number_slider_2, Steps=number_slider)
sin = Sine(Value=range)
cos = Cosine(Value=range)
pt = ConstructPoint(XCoordinate=range, YCoordinate=sin, ZCoordinate=cos)
nurbs = NurbsCurve(Vertices=pt, Degree=3, Periodic=False)  # -> Curve, Length, Domain
