# Grasshopper definition 014_WICKERSON.gh (Grasshopper 1.0.7)

number_slider = Slider(215, range=0..400)
number_slider_2 = Slider(48, range=0..48)
# Wickerson's Favorite .gh Scripts
# from WICKERSON
# HAMLET'S MILL
xy_plane = XYPlane(Origin=Point(0, 0, 0))
polygon = Polygon(Plane=xy_plane, Radius=number_slider, Segments=number_slider_2, FilletRadius=0)  # -> Polygon, Length
explode = Explode(Curve=polygon.Polygon, Recursive=True)  # -> Segments, Vertices
area = Area(Geometry=polygon.Polygon)  # -> Area, Centroid
point = Point(area.Centroid)
geometry = Geometry(explode.Segments)
move_away_from = MoveAwayFrom(Geometry=geometry, Emitter=point, Distance=Slider(40, range=0..40))  # -> Geometry, Transform
divide_curve = DivideCurve(Curve=move_away_from.Geometry, Count="1", Kinks=False)  # -> Points, Tangents, Parameters
divide_curve_2 = DivideCurve(Curve=geometry, Count="1", Kinks=False)  # -> Points, Tangents, Parameters
line = Line(StartPoint=divide_curve_2.Points, EndPoint=divide_curve.Points)
unit_z = UnitZ(Factor=Slider(10, range=0..10))
loft = Loft(Curves=line, Options={Adjust=False, Closed=False, LoftEnds=0, LoftSimp=0, LoftType=0, Rebuild=10, Refit=0.01})
extrude = Extrude(Base=loft, Direction=unit_z)
linear_array = LinearArray(Geometry=extrude, Direction=unit_z, Count=Slider(14, range=0..100))  # -> Geometry, Transform
integer = Integer(number_slider)
panel = Panel("""0
1""")
division = Division(A=integer, B=number_slider_2)
dispatch = Dispatch(List=linear_array.Geometry, DispatchPattern=panel)  # -> ListA, ListB
radians = Radians(Degrees=division)
geometry_2 = Geometry(dispatch.ListA)
rotate_3d = Rotate3D(Geometry=geometry_2, Angle=radians, Center=area.Centroid, Axis=unit_z)  # -> Geometry, Transform
geometry_3 = Geometry(dispatch.ListB)
merge = Merge(Data1=rotate_3d.Geometry, Data2=geometry_3)
param_viewer = ParamViewer(merge)
param_viewer_2 = ParamViewer(merge)
panel_2 = Panel(merge)
