# Grasshopper definition 015_WICKERSON.gh (Grasshopper 1.0.7)
# plug-ins: Fologram For Grasshopper Utilities

# Wickerson's Favorite .gh Scripts
# from WICKERSON
# BENDING ROPE
number_slider = Slider(100, range=0..100)
number_slider_2 = Slider(23, range=0..100)
range = Range(Domain=number_slider_2, Steps=number_slider)
sine = Sine(Value=range)
cosine = Cosine(Value=range)
division = Division(A=number_slider_2, B="2")
construct_point = ConstructPoint(XCoordinate=0, YCoordinate=0, ZCoordinate=division)
construct_point_2 = ConstructPoint(XCoordinate=sine, YCoordinate=cosine, ZCoordinate=range)
pi = Pi(Factor=[Slider(0, range=0..0.5), Slider(0.5, range=0..0.5), Slider(1, range=0..1), Slider(1.5, range=0..1.5)])
point = Point(construct_point)
rotate = Rotate(Geometry=construct_point_2, Angle=graft(pi), Plane=PlaneXY(0, 0, 0))  # -> Geometry, Transform
distance = Distance(PointA=rotate.Geometry, PointB=point)
unit_x = UnitX(Factor=distance)
negative = Negative(Value=unit_x)
move = Move(Geometry=rotate.Geometry, Motion=negative)  # -> Geometry, Transform
polyline = PolyLine(Vertices=move.Geometry, Closed=False)
mesh_pipe = MeshPipe(
    Polylines=polyline,
    NumberOfSides=Slider(6, range=0..10),
    Tolerance=0.1,
    Radius=Slider(0.499, range=0.1..0.5),
    Cap=False,
    Join=False)
