# Grasshopper definition 016_WICKERSON.gh (Grasshopper 1.0.7)

# ---- group: Plank Line
# Shape of Plank
number_slider = Slider(5, range=0..40)
# Width of Plank
# Length of Plank
number_slider_2 = Slider(1.004, range=0..3)
# Shape of Plank
number_slider_3 = Slider(5, range=0..10)
# Shape of Plank
number_slider_4 = Slider(2.501, range=0..4)
pi = Pi(Factor=number_slider)
dom = ConstructDomain(DomainStart=0, DomainEnd=pi)
range = Range(Domain=dom, Steps=Slider(43, range=0..100))
pi_2 = Pi(Factor=number_slider_4)
expression = Expression(A=number_slider_2, y=range, x=pi_2, w=number_slider_3, Expression="A*sin(w*y+x)")
vec = VectorXYZ(XComponent=range, YComponent=expression, ZComponent=Slider(0, range=0..10))  # -> Vector, Length

# ----
# Wickerson's Favorite .gh Scripts
# from WICKERSON
# HAUL SHIP
# Single Phase Sine Curve
number_slider_5 = Slider(4, range=0..100)
pi_3 = Pi(Factor=number_slider_5)
dom_2 = ConstructDomain(DomainStart=0, DomainEnd=pi_3)
pi_4 = Pi(Factor=Slider(0, range=0..4))
range_2 = Range(Domain=dom_2, Steps=Slider(128, range=0..128))
expression_2 = Expression(A=Slider(5, range=0..10), t=range_2, x=pi_4, w=Slider(1, range=0..2), Expression="A*sin(w*t+x)")
pt = ConstructPoint(XCoordinate=range_2, YCoordinate=Slider(6, range=0..10), ZCoordinate=expression_2)
intcrv = Interpolate(Vertices=pt, Degree=3, Periodic=False, KnotStyle=1)  # -> Curve, Length, Domain

# ----
# Outer Hull
crv = Curve(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)
rad = Radians(Degrees="180")
xz = XZPlane(Origin=Point(0, 0, 0))
vec_2 = VectorXYZ(XComponent=0, YComponent=0, ZComponent=-10)  # -> Vector, Length
vec_3 = VectorXYZ(XComponent=0, YComponent=0, ZComponent=-20)  # -> Vector, Length
vec_4 = VectorXYZ(XComponent=0, YComponent=0, ZComponent=20)  # -> Vector, Length
vec_5 = VectorXYZ(XComponent=0, YComponent=5, ZComponent=-25)  # -> Vector, Length
vec_6 = VectorXYZ(XComponent=0, YComponent=5, ZComponent=25)  # -> Vector, Length
vec_7 = VectorXYZ(XComponent=0, YComponent=10, ZComponent=-30)  # -> Vector, Length
vec_8 = VectorXYZ(XComponent=0, YComponent=10, ZComponent=30)  # -> Vector, Length
xz_2 = XZPlane(Origin=Point(0, 0, 0))
yz = YZPlane(Origin=Point(0, 0, 0))
yz_2 = YZPlane(Origin=Point(0, 0, 0))

# ---- group: Crazy Plank
# Height of Plank
number_slider_6 = Slider(5, range=0..20)
# Width of Plank
number_slider_7 = Slider(19, range=0..100)
pline = PolyLine(Vertices=vec.Vector, Closed=False)
# On Off
number_slider_8 = Slider(1, range=0..1)
# On Off
number_slider_9 = Slider(1, range=0..1)
dom_3 = ConstructDomain(DomainStart=0, DomainEnd=number_slider_7)
dom_4 = ConstructDomain(DomainStart=0, DomainEnd=number_slider_6)
range_3 = Range(Domain=dom_3, Steps=number_slider_9)
range_4 = Range(Domain=dom_4, Steps=number_slider_8)
vec_9 = VectorXYZ(XComponent=0, YComponent=0, ZComponent=range_4)  # -> Vector, Length
vec_10 = VectorXYZ(XComponent=0, YComponent=range_3, ZComponent=0)  # -> Vector, Length

# ----
cull_index = CullIndex(List=vec_9.Vector, Indices="0", Wrap=True)

# ---- group: Crazy Plank (continued)
extr = Extrude(Base=pline, Direction=cull_index)
extr_2 = Extrude(Base=extr, Direction=vec_10.Vector)

# ----
arrcurve = CurveArray(Geometry=extr_2, Curve=crv, Count=10)  # -> Geometry, Transform
rotate = Rotate(Geometry=arrcurve.Geometry, Angle=rad, Plane=xz)  # -> Geometry, Transform
join = BrepJoin(Breps=[rotate.Geometry, arrcurve.Geometry])  # -> Breps, Closed
scale = Scale(Geometry=join.Breps, Center=Point(0, 0, 0), Factor=expr("X*0.9", Slider(1, range=0..1)))  # -> flatten(Geometry), Transform
scale_2 = Scale(Geometry=join.Breps, Center=Point(0, 0, 0), Factor=expr("X*0.9", Slider(0.9, range=0..1)))  # -> flatten(Geometry), Transform
scale_3 = Scale(Geometry=join.Breps, Center=Point(0, 0, 0), Factor=expr("X*0.9", Slider(0.8, range=0..1)))  # -> flatten(Geometry), Transform
scale_4 = Scale(Geometry=join.Breps, Center=Point(0, 0, 0), Factor=expr("X*0.9", Slider(0.7, range=0..1)))  # -> flatten(Geometry), Transform
move = Move(Geometry=scale.Geometry, Motion=Vector(0, 0, 10))  # -> Geometry, Transform
move_2 = Move(Geometry=scale.Geometry, Motion=vec_2.Vector)  # -> Geometry, Transform
move_3 = Move(Geometry=scale_2.Geometry, Motion=vec_4.Vector)  # -> Geometry, Transform
move_4 = Move(Geometry=scale_2.Geometry, Motion=vec_3.Vector)  # -> Geometry, Transform
move_5 = Move(Geometry=scale_3.Geometry, Motion=vec_6.Vector)  # -> Geometry, Transform
move_6 = Move(Geometry=scale_3.Geometry, Motion=vec_5.Vector)  # -> Geometry, Transform
move_7 = Move(Geometry=scale_4.Geometry, Motion=vec_8.Vector)  # -> Geometry, Transform
move_8 = Move(Geometry=scale_4.Geometry, Motion=vec_7.Vector)  # -> Geometry, Transform
grp = Group([move.Geometry, join.Breps, move_2.Geometry, move_3.Geometry, move_4.Geometry, move_5.Geometry, move_6.Geometry, move_7.Geometry, move_8.Geometry])

# ---- group: inner
rotate_2 = Rotate(Geometry=grp, Angle=1.570796327, Plane=xz_2)  # -> Geometry, Transform

# ----
group = Group(Objects=rotate_2.Geometry)
group_2 = Group(Objects=grp)
rotate_3 = Rotate(Geometry=group_2, Angle=1.570796327, Plane=yz)  # -> Geometry, Transform
rotate_4 = Rotate(Geometry=group, Angle=1.570796327, Plane=yz_2)  # -> Geometry, Transform
scale_5 = Scale(Geometry=rotate_3.Geometry, Center=Point(0, 0, 0), Factor=0.5)  # -> Geometry, Transform
