# Grasshopper definition 017_WICKERSON.gh (Grasshopper 1.0.7)
# plug-ins: Bifocals

# Wickerson's Favorite .gh Scripts
# from WICKERSON
# SINE CURVE COIN
# Double Phase Sine Curve
# Single Phase Sine Curve
number_slider = Slider(17, range=0..100)
pi = Pi(Factor=number_slider)
pi_2 = Pi(Factor=number_slider)
dom = ConstructDomain(DomainStart=0, DomainEnd=pi)
dom_2 = ConstructDomain(DomainStart=0, DomainEnd=pi_2)
range = Range(Domain=dom, Steps=Slider(47, range=0..128))
pi_3 = Pi(Factor=Slider(0, range=0..4))
range_2 = Range(Domain=dom_2, Steps=Slider(128, range=0..128))
pi_4 = Pi(Factor=Slider(0, range=0..4))
expression = Expression(A=Slider(1, range=0..10), t=range, x=pi_3, w=Slider(2, range=0..2), Expression="A*sin(w*t+x)")
expression_2 = Expression(A=Slider(5, range=0..10), t=range_2, x=pi_4, w=Slider(1, range=0..2), Expression="A*sin(w*t+x)")
pt = ConstructPoint(XCoordinate=range, YCoordinate=0, ZCoordinate=expression)
pt_2 = ConstructPoint(XCoordinate=range_2, YCoordinate=Slider(50, range=0..55), ZCoordinate=expression_2)
intcrv = Interpolate(Vertices=pt, Degree=3, Periodic=False, KnotStyle=1)  # -> Curve, Length, Domain
intcrv_2 = Interpolate(Vertices=pt_2, Degree=3, Periodic=False, KnotStyle=1)  # -> Curve, Length, Domain
pt_3 = Point(Point(28.02086356, 24.1386481, 3.295137824))
loft = Loft(
    Curves=[intcrv.Curve, intcrv_2.Curve],
    Options={Adjust=False, Closed=False, LoftEnds=0, LoftSimp=0, LoftType=0, Rebuild=10, Refit=0.01})
Z = UnitZ(Factor=Slider(12, range=0..20))
extr = Extrude(Base=loft, Direction=Z)
volume = Volume(Geometry=extr)  # -> Volume, Centroid
cyl = Cylinder(Base=volume.Centroid, Radius=Slider(24, range=0..100), Length=Slider(33, range=0..100))
unit_z = UnitZ(Factor=Slider(-13, range=-20..100))
cap = CapHoles(Brep=cyl)
move = Move(Geometry=cap, Motion=unit_z)  # -> Geometry, Transform
sint = SolidIntersection(BrepsA=move.Geometry, BrepsB=extr)
