# Grasshopper definition 018_WICKERSON.gh (Grasshopper 1.0.7)

range = Range(Domain=Domain(0, 1), Steps=Slider(6, range=0..20))
range_2 = Range(Domain=Domain(0, 1), Steps=Slider(6, range=0..20))
range_3 = Range(Domain=Domain(0, 1), Steps=Slider(12, range=0..100))
graph = GraphMapper(
    range_2,
    x0=0,
    x1=1,
    y0=0,
    y1=1,
    container_name="Bezier",
    cpx=[0, 0, 0.1994830519, 1],
    cpy=[1, 0, 0.2306893468, 0.2406086326])
graph_2 = GraphMapper(
    range,
    x0=0,
    x1=1,
    y0=0,
    y1=1,
    container_name="Bezier",
    cpx=[0, 0.3682320416, 0.7260834575, 1],
    cpy=[0.1164439917, 0.1405148506, 0.8660486341, 0.3691895604])
graph_3 = GraphMapper(
    range,
    x0=0,
    x1=1,
    y0=0,
    y1=1,
    container_name="Bezier",
    cpx=[0, 0.3300861418, 0.6215083599, 1],
    cpy=[1, 0.5735952854, 0.8788369298, 0.3110622168])
graph_4 = GraphMapper(
    range_2,
    x0=0,
    x1=1,
    y0=0,
    y1=1,
    container_name="Bezier",
    cpx=[0, 0.2710659504, 0.7989848852, 1],
    cpy=[0.1164439917, 0, 0.2173913121, 0.3652171493])
graph_5 = GraphMapper(
    range_3,
    x0=0,
    x1=1,
    y0=0,
    y1=1,
    container_name="Bezier",
    cpx=[0, 0.3682320416, 0.7260834575, 1],
    cpy=[0.1164439917, 0.1405148506, 0.8660486341, 0.3691895604])
graph_6 = GraphMapper(
    range_3,
    x0=0,
    x1=1,
    y0=0,
    y1=1,
    container_name="Bezier",
    cpx=[0, 0.3300861418, 0.6215083599, 1],
    cpy=[1, 0.5735952854, 0.8788369298, 0.3110622168])
# Wickerson's Favorite .gh Scripts
# from WICKERSON
# WHEEL BARROW
number_slider = Slider(27, range=0..100)
multiplication = Multiplication(A=graph_2, B=Slider(15, range=0..100))
multiplication_2 = Multiplication(A=range, B=Slider(41, range=0..100))
multiplication_3 = Multiplication(A=graph_4, B=Slider(15, range=0..100))
multiplication_4 = Multiplication(A=range_2, B=Slider(41, range=0..100))
multiplication_5 = Multiplication(A=graph_5, B=Slider(47, range=0..100))
multiplication_6 = Multiplication(A=range_3, B=Slider(69, range=0..100))
expression = Expression(x=graph_3, y=Slider(0.256, range=0..4), Expression="pi/2*x*y")
expression_2 = Expression(x=graph, y=Slider(0.256, range=0..4), Expression="pi/2*x*y")
expression_3 = Expression(x=graph_6, y=Slider(0.416, range=0..4), Expression="pi/2*x*y")
addition = Addition(A=multiplication_2, B=Slider(23, range=0..100))
addition_2 = Addition(A=multiplication_4, B=Slider(6, range=0..100))
addition_3 = Addition(A=multiplication_6, B=number_slider)
pt = ConstructPoint(XCoordinate=0, YCoordinate=addition, ZCoordinate=multiplication)
pt_2 = ConstructPoint(XCoordinate=0, YCoordinate=addition_2, ZCoordinate=multiplication_3)
pt_3 = ConstructPoint(XCoordinate=0, YCoordinate=addition_3, ZCoordinate=multiplication_5)
neg = Negative(Value=expression)
neg_2 = Negative(Value=expression_2)
neg_3 = Negative(Value=expression_3)
rotate = Rotate(Geometry=pt, Angle=expression, Plane=PlaneXY(0, 0, 0))  # -> Geometry, Transform
rotate_2 = Rotate(Geometry=pt_2, Angle=expression_2, Plane=PlaneXY(0, 0, 0))  # -> Geometry, Transform
rotate_3 = Rotate(Geometry=pt_3, Angle=expression_3, Plane=PlaneXY(0, 0, 0))  # -> Geometry, Transform
rotate_4 = Rotate(Geometry=pt, Angle=neg, Plane=PlaneXY(0, 0, 0))  # -> Geometry, Transform
rotate_5 = Rotate(Geometry=pt_2, Angle=neg_2, Plane=PlaneXY(0, 0, 0))  # -> Geometry, Transform
rotate_6 = Rotate(Geometry=pt_3, Angle=neg_3, Plane=PlaneXY(0, 0, 0))  # -> Geometry, Transform
intcrv = Interpolate(Vertices=rotate.Geometry, Degree=3, Periodic=False, KnotStyle=1)  # -> Curve, Length, Domain
intcrv_2 = Interpolate(Vertices=rotate_4.Geometry, Degree=3, Periodic=False, KnotStyle=1)  # -> Curve, Length, Domain
intcrv_3 = Interpolate(Vertices=rotate_2.Geometry, Degree=3, Periodic=False, KnotStyle=1)  # -> Curve, Length, Domain
intcrv_4 = Interpolate(Vertices=pt, Degree=3, Periodic=False, KnotStyle=1)  # -> Curve, Length, Domain
intcrv_5 = Interpolate(Vertices=rotate_5.Geometry, Degree=3, Periodic=False, KnotStyle=1)  # -> Curve, Length, Domain
intcrv_6 = Interpolate(Vertices=pt_2, Degree=3, Periodic=False, KnotStyle=1)  # -> Curve, Length, Domain
intcrv_7 = Interpolate(Vertices=rotate_3.Geometry, Degree=3, Periodic=False, KnotStyle=1)  # -> Curve, Length, Domain
intcrv_8 = Interpolate(Vertices=rotate_6.Geometry, Degree=3, Periodic=False, KnotStyle=1)  # -> Curve, Length, Domain
intcrv_9 = Interpolate(Vertices=pt_3, Degree=3, Periodic=False, KnotStyle=1)  # -> Curve, Length, Domain
number_slider_2 = Slider(13, range=0..25)
number_slider_3 = Slider(29, range=0..120)
Z = UnitZ(Factor=Slider(12, range=0..12))
Z_2 = UnitZ(Factor=Slider(4, range=0..12))
Z_3 = UnitZ(Factor=Slider(4, range=0..12))
loft = Loft(
    Curves=[intcrv.Curve, intcrv_4.Curve, intcrv_2.Curve],
    Options={Adjust=False, Closed=False, LoftEnds=0, LoftSimp=0, LoftType=0, Rebuild=10, Refit=0.01})
loft_2 = Loft(
    Curves=[intcrv_3.Curve, intcrv_6.Curve, intcrv_5.Curve],
    Options={Adjust=False, Closed=False, LoftEnds=0, LoftSimp=0, LoftType=0, Rebuild=10, Refit=0.01})
neg_4 = Negative(Value=number_slider_2)
loft_3 = Loft(
    Curves=[intcrv_7.Curve, intcrv_9.Curve, intcrv_8.Curve],
    Options={Adjust=False, Closed=False, LoftEnds=0, LoftSimp=0, LoftType=0, Rebuild=10, Refit=0.01})
extr = Extrude(Base=loft, Direction=Z)
extr_2 = Extrude(Base=loft_2, Direction=Z_2)
extr_3 = Extrude(Base=loft_3, Direction=Z_3)
pt_4 = ConstructPoint(XCoordinate=neg_4, YCoordinate=number_slider_3, ZCoordinate=0)
Y = UnitY(Factor=Slider(50, range=0..100))
Y_2 = UnitY(Factor=Slider(50, range=0..100))
pt_5 = ConstructPoint(XCoordinate=number_slider_2, YCoordinate=number_slider_3, ZCoordinate=0)
move = Move(Geometry=extr_3, Motion=Y_2)  # -> Geometry, Transform
move_2 = Move(Geometry=extr, Motion=Y)  # -> Geometry, Transform
move_3 = Move(Geometry=extr_2, Motion=pt_5)  # -> Geometry, Transform
move_4 = Move(Geometry=extr_2, Motion=pt_4)  # -> Geometry, Transform
sdiff = SolidDifference(BrepsA=move.Geometry, BrepsB=move_2.Geometry)
pi = Pi(Factor=Slider(1, range=0..1))
sunion = SolidUnion(Breps=[move_4.Geometry, sdiff, move_3.Geometry])
xz = XZPlane(Origin=Point(0, 0, 0))
neg_5 = Negative(Value=Slider(144, range=0..200))
rotate_7 = Rotate(Geometry=sunion, Angle=pi, Plane=xz)  # -> Geometry, Transform
pt_6 = ConstructPoint(XCoordinate=0, YCoordinate=neg_5, ZCoordinate=Slider(43, range=0..100))
move_5 = Move(Geometry=rotate_7.Geometry, Motion=pt_6)  # -> Geometry, Transform
pi_2 = Pi(Factor=Slider(0.1, range=0..0.5))
yz = YZPlane(Origin=Point(0, 0, 0))
rotate_8 = Rotate(Geometry=move_5.Geometry, Angle=pi_2, Plane=yz)  # -> Geometry, Transform
