# Grasshopper definition 019_WICKERSON.gh (Grasshopper 1.0.7)

# ---- group: Thickness of Wheel
# Parametric Wheel (cylinder)
width_of_wheel = Slider(18, range=1..40)
# SINE CURVE COIN WITH HOLES
rholes = Slider(7, range=0..10)
# Wickerson's Favorite .gh Scripts
# from WICKERSON
circle = Circle({Plane=Plane(origin=(0, 0, 0), x=(0.1788854382, 0.9838699101, 0), y=(-0.9838699101, 0.1788854382, 0)), Radius=22.36067977})
cyl = Cylinder(Base=PlaneXY(0, 0, 0), Radius=rholes, Length=width_of_wheel)
cyl_2 = Cylinder(Base=PlaneXY(0, 0, 0), Radius=Slider(38, range=27..60), Length=width_of_wheel)
X = UnitX(Factor=Slider(27, range=23..40))
cap = CapHoles(Brep=cyl)
move = Move(Geometry=cap, Motion=X)  # -> Geometry, Transform
cap_2 = CapHoles(Brep=cyl_2)
arrcurve = CurveArray(Geometry=move.Geometry, Curve=circle, Count=Slider(6, range=2..10))  # -> Geometry, Transform

# ----
# Double Phase Sine Curve
number_slider = Slider(24, range=0..100)
wobble = Slider(16, range=0..128)
pi = Pi(Factor=number_slider)
dom = ConstructDomain(DomainStart=0, DomainEnd=pi)
pi_2 = Pi(Factor=Slider(2.304, range=0..4))
range = Range(Domain=dom, Steps=wobble)
expression = Expression(A=Slider(7, range=0..10), t=range, x=pi_2, w=Slider(1, range=0..2), Expression="A*sin(w*t+x)")
pt = ConstructPoint(XCoordinate=range, YCoordinate=Slider(5, range=0..10), ZCoordinate=expression)
intcrv = Interpolate(Vertices=pt, Degree=3, Periodic=False, KnotStyle=1)  # -> Curve, Length, Domain
Y = UnitY(Factor=Slider(85, range=0..200))
move_2 = Move(Geometry=intcrv.Curve, Motion=Y)  # -> Geometry, Transform

# ----
# Single Phase Sine Curve
number_slider_2 = Slider(25, range=0..100)
wobble_2 = Slider(27, range=0..128)
pi_3 = Pi(Factor=number_slider_2)
dom_2 = ConstructDomain(DomainStart=0, DomainEnd=pi_3)
pi_4 = Pi(Factor=Slider(1.28, range=0..4))
range_2 = Range(Domain=dom_2, Steps=wobble_2)
expression_2 = Expression(A=Slider(4, range=0..10), t=range_2, x=pi_4, w=Slider(1, range=0..2), Expression="A*sin(w*t+x)")
pt_2 = ConstructPoint(XCoordinate=range_2, YCoordinate=Slider(6, range=0..10), ZCoordinate=expression_2)
intcrv_2 = Interpolate(Vertices=pt_2, Degree=3, Periodic=False, KnotStyle=1)  # -> Curve, Length, Domain

loft = Loft(
    Curves=[move_2.Geometry, intcrv_2.Curve],
    Options={Adjust=False, Closed=False, LoftEnds=0, LoftSimp=0, LoftType=0, Rebuild=10, Refit=0.01})

# ---- group: Sine Solid
Z = UnitZ(Factor=width_of_wheel)
neg = Negative(Value=Slider(49, range=0..100))
extr = Extrude(Base=loft, Direction=Z)
Y_2 = UnitY(Factor=neg)
cap_3 = CapHoles(Brep=extr)
neg_2 = Negative(Value=Slider(38, range=0..100))
move_3 = Move(Geometry=cap_3, Motion=Y_2)  # -> Geometry, Transform
X_2 = UnitX(Factor=neg_2)
move_4 = Move(Geometry=move_3.Geometry, Motion=Vector(0, 0, 10))  # -> Geometry, Transform
move_5 = Move(Geometry=move_3.Geometry, Motion=X_2)  # -> Geometry, Transform

# ---- group: Rectangle Circle Wheel
number_slider_3 = Slider(41, range=0..100)
Z_2 = UnitZ(Factor=Slider(59, range=0..100))
rectangle = Rectangle(Plane=PlaneXY(0, 0, 0), XSize=number_slider_3, YSize=number_slider_3, Radius=number_slider_3)  # -> Rectangle, Length
extr_2 = Extrude(Base=rectangle.Rectangle, Direction=Z_2)
# Hybrid Wheel (Cyl/Cone)
cap_4 = CapHoles(Brep=extr_2)

# ----
sdiff = SolidDifference(BrepsA=cap_2, BrepsB=arrcurve.Geometry)
sint = SolidIntersection(BrepsA=sdiff, BrepsB=move_5.Geometry)
