# Grasshopper definition 020_WICKERSON.gh (Grasshopper 1.0.7)
# plug-ins: Bifocals

separate_wheels = Slider(150, range=40..200)
wheelface_scale = Slider(1.131, range=0..2)
# Wickerson's Favorite .gh Scripts
# from WICKERSON
# WHEELS
# Wheels
diameter = Slider(142, range=0..200)
hole_radii = Slider(21, range=0..100)
thickness = Slider(50, range=0..100)
hole_slider = Slider(89, range=0..100)
angle_wheels = Slider(0.54, range=0.4..0.6)
of_holes = Slider(9, range=0..10)
circle = Circle(Plane=PlaneXY(0, 0, 0), Radius=hole_radii)
unit_x = UnitX(Factor=hole_slider)
move = Move(Geometry=circle, Motion=unit_x)  # -> Geometry, Transform
unit_z = UnitZ(Factor=thickness)
polar_array = PolarArray(Geometry=move.Geometry, Plane=PlaneXY(0, 0, 0), Count=of_holes, Angle=6.283185307)  # -> Geometry, Transform
move_2 = Move(Geometry=polar_array.Geometry, Motion=unit_z)  # -> Geometry, Transform
area = Area(Geometry=move_2.Geometry)  # -> Area, Centroid
scale = Scale(Geometry=move_2.Geometry, Center=area.Centroid, Factor=wheelface_scale)  # -> Geometry, Transform
circle_2 = Circle(Plane=PlaneXY(0, 0, 0), Radius=diameter)
move_3 = Move(Geometry=circle_2, Motion=unit_z)  # -> Geometry, Transform
area_2 = Area(Geometry=move_3.Geometry)  # -> Area, Centroid
scale_2 = Scale(Geometry=move_3.Geometry, Center=area_2.Centroid, Factor=wheelface_scale)  # -> Geometry, Transform
flip_matrix = FlipMatrix(Data=scale.Geometry)
flip_matrix_2 = FlipMatrix(Data=polar_array.Geometry)
boundary_surfaces = BoundarySurfaces(Edges=polar_array.Geometry)
boundary_surfaces_2 = BoundarySurfaces(Edges=circle_2)
boundary_surfaces_3 = BoundarySurfaces(Edges=scale_2.Geometry)
boundary_surfaces_4 = BoundarySurfaces(Edges=scale.Geometry)
loft = Loft(
    Curves=[circle_2, scale_2.Geometry],
    Options={Adjust=False, Closed=False, LoftEnds=0, LoftSimp=0, LoftType=0, Rebuild=10, Refit=0.01})
loft_2 = Loft(
    Curves=[flip_matrix_2, flip_matrix],
    Options={Adjust=False, Closed=False, LoftEnds=0, LoftSimp=0, LoftType=0, Rebuild=10, Refit=0.01})
solid_difference = SolidDifference(BrepsA=boundary_surfaces_3, BrepsB=boundary_surfaces_4)
solid_difference_2 = SolidDifference(BrepsA=boundary_surfaces_2, BrepsB=boundary_surfaces)
pi = Pi(Factor=angle_wheels)
brep_join = BrepJoin(Breps=[solid_difference, loft, solid_difference_2, loft_2])  # -> Breps, Closed
xz_plane = XZPlane(Origin=Point(0, 0, 0))
rotate_3d = Rotate3D(Geometry=brep_join.Breps, Angle=pi, Center=Point(0, 0, 0), Axis=xz_plane)  # -> Geometry, Transform
unit_x_2 = UnitX(Factor=separate_wheels)
move_4 = Move(Geometry=rotate_3d.Geometry, Motion=unit_x_2)  # -> Geometry, Transform
mirror = Mirror(Geometry=move_4.Geometry, Plane=PlaneYZ(0, 0, 0))  # -> Geometry, Transform
brep_join_2 = BrepJoin(Breps=[move_4.Geometry, mirror.Geometry])  # -> Breps, Closed
