# Grasshopper definition 031_WICKERSON.gh (Grasshopper 1.0.7)
# plug-ins: Bifocals, Fologram For Grasshopper Utilities

point_x = Slider(50, range=0..100)
point_y = Slider(23, range=0..100)
point_z = Slider(57, range=0..100)

# ----
# Play
length = Slider(0.139, range=0..1)
length_2 = Slider(443, range=0..1000)
amp = Slider(7, range=0..100)
number_coils = Slider(5, range=1..6)
pipe_radii = Slider(0.26, range=0..2)

construct_point = ConstructPoint(XCoordinate=point_x, YCoordinate=point_y, ZCoordinate=point_z)
unit_x = UnitX(Factor=1)
start = Start(Point(0, 0, 0))
arc_sed = ArcSED(Start=start, End=construct_point, Direction=unit_x)  # -> Arc, Plane, Radius

# ----
# Wickerson's Favorite .gh Scripts
# from WICKERSON
series = Series(Start=0, Step=length, Count=length_2)
sine = Sine(Value=series)
cosine = Cosine(Value=series)
multiplication = Multiplication(A=sine, B=amp)
multiplication_2 = Multiplication(A=cosine, B=amp)
construct_point_2 = ConstructPoint(XCoordinate=series, YCoordinate=multiplication, ZCoordinate=multiplication_2)
yz_plane = YZPlane(Origin=Point(0, 0, 0))
interpolate = Interpolate(Vertices=construct_point_2, Degree=3, Periodic=False, KnotStyle=1)  # -> Curve, Length, Domain
polar_array = PolarArray(Geometry=interpolate.Curve, Plane=yz_plane, Count=number_coils, Angle=6.283185307)  # -> Geometry, Transform

# ----
# Disconnect and Play
bend_deform = BendDeform(Geometry=polar_array.Geometry, BendingArc=arc_sed.Arc)

mesh_pipe = MeshPipe(Polylines=bend_deform, NumberOfSides=Slider(6, range=0..10), Tolerance=0.1, Radius=pipe_radii, Cap=False, Join=False)

# ----
# Pipe and Bake
pipe = Pipe(Curve=bend_deform, Radius=pipe_radii, Caps=0)  # disabled
