# Grasshopper definition 032_WICKERSON.gh (Grasshopper 1.0.7)
# plug-ins: Bifocals

number_slider = Slider(100, range=0..100)
number_slider_2 = Slider(19, range=0..100)
unit_x = UnitX(Factor=number_slider)
unit_z = UnitZ(Factor=number_slider)
center_box = CenterBox(Base=PlaneXY(0, 0, 0), X=number_slider_2, Y=number_slider_2, Z=number_slider_2)
move = Move(Geometry=center_box, Motion=unit_x)  # -> Geometry, Transform
polar_array = PolarArray(Geometry=move.Geometry, Plane=PlaneXY(0, 0, 0), Count=10, Angle=6.283185307)  # -> Geometry, Transform

number_slider_3 = Slider(12, range=0..100)
center_box_2 = CenterBox(Base=PlaneXY(0, 0, 0), X=number_slider_3, Y=number_slider_3, Z=number_slider_3)

# ----
# internalized GEO
geometry = Geometry(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)

# ----
# Wickerson's Favorite .gh Scripts
# from WICKERSON
brep = Brep(geometry)
geometry_2 = Geometry(brep)
populate_geometry = PopulateGeometry(Geometry=geometry_2, Count=Slider(34, range=0..100), Seed=Slider(10, range=0..100))
voronoi_3d = Voronoi3D(Points=populate_geometry, Box=geometry_2)  # -> graft(Cells), Boundary
solid_intersection = SolidIntersection(BrepsA=geometry_2, BrepsB=voronoi_3d.Cells)  # -> flatten(Result)
deconstruct_brep = DeconstructBrep(Brep=solid_intersection)  # -> Faces, Edges, Vertices
md_slider = MDSlider(SliderMode=0, slider_value=Point(0.5, 0.5, 0.5), x_domain=Domain(0, 1), y_domain=Domain(0, 1), z_domain=Domain(0, 1))
list_item = ListItem(List=deconstruct_brep.Faces, Index=0, Wrap=True)
list_item_2 = ListItem(List=deconstruct_brep.Faces, Index=Slider(4, range=0..10), Wrap=True)
list_item_3 = ListItem(List=deconstruct_brep.Faces, Index=Slider(6, range=0..10), Wrap=True)
list_item_4 = ListItem(List=deconstruct_brep.Faces, Index=Slider(3, range=0..10), Wrap=True)
list_item_5 = ListItem(List=deconstruct_brep.Faces, Index=Slider(5, range=0..10), Wrap=True)
list_item_6 = ListItem(List=deconstruct_brep.Faces, Index=Slider(2, range=0..10), Wrap=True)
list_item_7 = ListItem(List=deconstruct_brep.Faces, Index=Slider(1, range=0..1), Wrap=True)
list_item_8 = ListItem(List=deconstruct_brep.Faces, Index=Slider(7, range=0..10), Wrap=True)
list_item_9 = ListItem(List=deconstruct_brep.Faces, Index=Slider(8, range=0..10), Wrap=True)
list_item_10 = ListItem(List=deconstruct_brep.Faces, Index=Slider(9, range=0..10), Wrap=True)
list_item_11 = ListItem(List=deconstruct_brep.Faces, Index=Slider(10, range=0..10), Wrap=True)
evaluate_surface = EvaluateSurface(Surface=list_item, Point=md_slider)  # -> Point, Normal, Frame
multiplication = Multiplication(A=evaluate_surface.Normal, B=Slider(0, range=0..40))

move_2 = Move(Geometry=list_item, Motion=multiplication)  # -> Geometry, Transform
move_3 = Move(Geometry=list_item_7, Motion=multiplication)  # -> Geometry, Transform
move_4 = Move(Geometry=list_item_6, Motion=multiplication)  # -> Geometry, Transform
move_5 = Move(Geometry=list_item_4, Motion=multiplication)  # -> Geometry, Transform
move_6 = Move(Geometry=list_item_2, Motion=multiplication)  # -> Geometry, Transform
move_7 = Move(Geometry=list_item_5, Motion=multiplication)  # -> Geometry, Transform
move_8 = Move(Geometry=list_item_3, Motion=multiplication)  # -> Geometry, Transform
move_9 = Move(Geometry=list_item_8, Motion=multiplication)  # -> Geometry, Transform
move_10 = Move(Geometry=list_item_9, Motion=multiplication)  # -> Geometry, Transform
move_11 = Move(Geometry=list_item_10, Motion=multiplication)  # -> Geometry, Transform
move_12 = Move(Geometry=list_item_11, Motion=multiplication)  # -> Geometry, Transform
