# Grasshopper definition 033_WICKERSON.gh (Grasshopper 1.0.7)
# plug-ins: Bifocals

# from WICKERSON
number_slider = Slider(7, range=3..13)
# Wickerson's Favorite .gh Scripts
polygon = Polygon(Plane=PlaneXY(0, 0, 0), Radius=3, Segments=number_slider, FilletRadius=0)  # -> Polygon, Length
md_slider = MDSlider(
    SliderMode=0,
    slider_value=Point(0.6305307528, 0.6773182939, 0.5),
    x_domain=Domain(0, 1),
    y_domain=Domain(0, 1),
    z_domain=Domain(0, 1))
horizontal_frames = HorizontalFrames(Curve=polygon.Polygon, Count=number_slider)  # -> Frames, Parameters
area = Area(Geometry=horizontal_frames.Frames)  # -> Area, Centroid
evaluate_surface = EvaluateSurface(Surface=reparameterize(horizontal_frames.Frames), Point=md_slider)  # -> Point, Normal, Frame
vector_2pt = Vector2Pt(PointA=area.Centroid, PointB=evaluate_surface.Point, Unitize=False)  # -> Vector, Length
line_sdl = LineSDL(Start=area.Centroid, Direction=vector_2pt.Vector, Length=Slider(3, range=0..100))
point_on_curve = PointOnCurve(line_sdl, parameter=0.125)
panel = Panel(point_on_curve)
shift_list = ShiftList(List=point_on_curve, Shift=1, Wrap=True)
point_on_curve_2 = PointOnCurve(line_sdl, parameter=0.496)
panel_2 = Panel(shift_list)
line = Line(StartPoint=point_on_curve_2, EndPoint=shift_list)
interpolate = Interpolate(Vertices=point_on_curve_2, Degree=3, Periodic=True, KnotStyle=1)  # -> Curve, Length, Domain
area_2 = Area(Geometry=polygon.Polygon)  # -> Area, Centroid
join_curves = JoinCurves(Curves=[line, interpolate.Curve, line_sdl], Preserve=False)
line_2 = Line(StartPoint=area_2.Centroid, EndPoint=point_on_curve_2)
pipe = Pipe(Curve=join_curves, Radius=Slider(0.06, range=0..1), Caps=0)
