# Grasshopper definition 035_WICKERSON.gh (Grasshopper 1.0.7)
# plug-ins: Bifocals

# Wickerson's Favorite .gh Scripts
# from WICKERSON
number_slider = Slider(24, range=0..100)
range = Range(Domain=number_slider, Steps=Slider(23, range=0..100))
sine = Sine(Value=range)
cosine = Cosine(Value=range)
construct_point = ConstructPoint(XCoordinate=range, YCoordinate=sine, ZCoordinate=cosine)
ellipse = Ellipse(Plane=PlaneXY(0, 0, 0), Radius1=Slider(1.94, range=0.1..2), Radius2=Slider(1.53, range=0.1..2))  # -> Ellipse, Focus1, Focus2
pi = Pi(Factor=expr("-x", Slider(0, range=0..2)))
pi_2 = Pi(Factor=Slider(0.55, range=0.1..1))
interpolate = Interpolate(Vertices=construct_point, Degree=3, Periodic=False, KnotStyle=1)  # -> Curve, Length, Domain
yz_plane = YZPlane(Origin=Point(0, 0, 0))
construct_plane = ConstructPlane(Origin=Point(0, 0, 0), XAxis=Vector(-0.6663495754, 0, 2.521591296), YAxis=Vector(3.98524537, 2.82605431, 0))
rotate = Rotate(Geometry=ellipse.Ellipse, Angle=pi_2, Plane=yz_plane)  # -> Geometry, Transform
rotate_2 = Rotate(Geometry=interpolate.Curve, Angle=pi, Plane=construct_plane)  # -> Geometry, Transform
sweep1 = Sweep1(Rail=rotate_2.Geometry, Sections=rotate.Geometry, Miter=1)
cap_holes = CapHoles(Brep=sweep1)
mirror = Mirror(Geometry=cap_holes, Plane=PlaneYZ(0, 0, 0))  # -> Geometry, Transform
unit_y = UnitY(Factor=Slider(4, range=0..100))
brep_join = BrepJoin(Breps=[cap_holes, mirror.Geometry])  # -> Breps, Closed
move = Move(Geometry=brep_join.Breps, Motion=expr("-x", unit_y))  # -> Geometry, Transform
xz_plane = XZPlane(Origin=Point(0, 0, 0))
mirror_2 = Mirror(Geometry=move.Geometry, Plane=xz_plane)  # -> Geometry, Transform
brep_join_2 = BrepJoin(Breps=[mirror_2.Geometry, move.Geometry])  # -> Breps, Closed
