# Grasshopper definition 037_WICKERSON.gh (Grasshopper 1.0.7)
# plug-ins: Bifocals

# ----
# Wickerson's Favorite .gh Scripts
# from WICKERSON
# Play
length = Slider(0.329, range=0..1)
length_2 = Slider(229, range=0..1000)
amp = Slider(24, range=0..100)
number_coils = Slider(4, range=1..6)
pipe_radii = Slider(0.23, range=0..2)

point_x = Slider(26, range=0..100)
point_y = Slider(32, range=0..100)
point_z = Slider(73, range=0..100)

construct_point = ConstructPoint(XCoordinate=point_x, YCoordinate=point_y, ZCoordinate=point_z)
unit_x = UnitX(Factor=1)
start = Start(Point(0, 0, 0))
arc_sed = ArcSED(Start=start, End=construct_point, Direction=unit_x)  # -> Arc, Plane, Radius

series = Series(Start=0, Step=length, Count=length_2)
sine = Sine(Value=series)
cosine = Cosine(Value=series)
multiplication = Multiplication(A=sine, B=amp)
multiplication_2 = Multiplication(A=cosine, B=amp)
construct_point_2 = ConstructPoint(XCoordinate=series, YCoordinate=multiplication, ZCoordinate=multiplication_2)
yz_plane = YZPlane(Origin=Point(0, 0, 0))
interpolate = Interpolate(Vertices=construct_point_2, Degree=3, Periodic=False, KnotStyle=1)  # -> Curve, Length, Domain
polar_array = PolarArray(Geometry=interpolate.Curve, Plane=yz_plane, Count=number_coils, Angle=6.283185307)  # -> Geometry, Transform

# ----
# Disconnect and Play
bend_deform = BendDeform(Geometry=polar_array.Geometry, BendingArc=arc_sed.Arc)

# ----
# Pipe and Bake
pipe = Pipe(Curve=bend_deform, Radius=pipe_radii, Caps=0)
