# Grasshopper definition 038_WICKERSON.gh (Grasshopper 1.0.7)
# plug-ins: Firefly.X, Bifocals

# Wickerson's Favorite .gh Scripts
# from WICKERSON
number_slider = Slider(2, range=0..10)
curve = Curve(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)
sound_capture = SoundCapture(TimePeriod=Slider(0.02, range=0..0.1), StartStopSoundCapture=Toggle(True))  # -> WavePressureSamplesFromLeftChannel, WavePressureSamplesFromRightChannel, Volume
timer = Timer(Interval=20, TimerInterval=20, Target=sound_capture)
panel = Panel(sound_capture.Volume)
data_recorder = DataRecorder(sound_capture.Volume, DataLimit=12, RecordData=True)
series = Series(Start=number_slider, Step=number_slider, Count=Slider(19, range=0..100))
multiplication = Multiplication(A=data_recorder, B=Slider(0.894, range=0.02..2))
polygon = Polygon(Plane=PlaneXY(0, 0, 0), Radius=series, Segments=Slider(6, range=0..10), FilletRadius=0)  # -> Polygon, Length
divide_curve = DivideCurve(Curve=curve, Count=Slider(12, range=0..100), Kinks=False)  # -> Points, Tangents, Parameters
unit_z = UnitZ(Factor=multiplication)
move = Move(Geometry=reverse(polygon.Polygon), Motion=unit_z)  # -> Geometry, Transform
move_2 = Move(Geometry=divide_curve.Points, Motion=unit_z)  # -> Geometry, Transform
loft = Loft(Curves=move.Geometry, Options={Adjust=False, Closed=False, LoftEnds=0, LoftSimp=0, LoftType=0, Rebuild=10, Refit=0.01})
line = Line(StartPoint=divide_curve.Points, EndPoint=move_2.Geometry)
panel_2 = Panel(data_recorder)
interpolate = Interpolate(Vertices=move_2.Geometry, Degree=3, Periodic=False, KnotStyle=1)  # -> Curve, Length, Domain
polyline = PolyLine(Vertices=move_2.Geometry, Closed=False)
pipe = Pipe(Curve=line, Radius=Slider(6, range=0..10), Caps=0)
geometry = Geometry(loft)
