# Grasshopper definition 039_WICKERSON.gh (Grasshopper 1.0.7)
# plug-ins: Bifocals, Fologram For Grasshopper Utilities

# Wickerson's Favorite .gh Scripts
# from WICKERSON
number_slider = Slider(2, range=0..10)
ghpython_script = GhPythonScript(x=number_slider, y=Slider(7, range=0..10), z=Slider(1.15, range=0..2))  # -> out, a, b, c, d; inputs x: Int32, y: Int32
# ---------- ghpython_script: Python ----------
import rhinoscriptsyntax as rs
import math

print x
points = range(x,x*y**2,10)
print points

a = points
print a


b = a*x
print b


c = math.cos(z)
#c = math.sin(z)
#c = math.tan(z)

lenB = len(b)
print lenB

#d = lenB *c
d = lenB *c
# ---------- end ghpython_script ----------
construct_point = ConstructPoint(XCoordinate=ghpython_script.a, YCoordinate=ghpython_script.b, ZCoordinate=ghpython_script.d)
construct_domain = ConstructDomain(DomainStart=ghpython_script.c, DomainEnd=Slider(1.37, range=0..2))
list_length = ListLength(List=ghpython_script.a)
panel = Panel(ghpython_script.out)
param_viewer = ParamViewer(ghpython_script.b)
interpolate = Interpolate(Vertices=construct_point, Degree=3, Periodic=False, KnotStyle=1)  # -> Curve, Length, Domain
range = Range(Domain=construct_domain, Steps=list_length)
pi = Pi(Factor=range)
panel_2 = Panel(ghpython_script.a)
rotate_3d = Rotate3D(Geometry=interpolate.Curve, Angle=pi, Center=Point(0, 0, 0), Axis=Vector(0, 0, 1))  # -> Geometry, Transform
panel_3 = Panel(ghpython_script.b)
multiplication = Multiplication(A=ghpython_script.a, B=Slider(0.035, range=0..1))
panel_4 = Panel(ghpython_script.c)
mesh_pipe = MeshPipe(Polylines=rotate_3d.Geometry, NumberOfSides=4, Tolerance=0.1, Radius=multiplication, Cap=False, Join=False)
