# Grasshopper definition 051_WICKERSON.gh (Grasshopper 1.0.7)
# Copyright: Wickerson Studios
# plug-ins: Bifocals, MeshEdit Components

number_slider = Slider(1, range=0..1)
# Wickerson's Favorite .gh Scripts
# from WICKERSON
surface = Surface(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)
construct_domain² = ConstructDomain²(DomainU=number_slider, DomainV=number_slider)
area = Area(Geometry=surface)  # -> Area, Centroid
isotrim = Isotrim(Surface=reparameterize(surface), Domain=construct_domain²)
number_slider_2 = Slider(23, range=0..100)
deconstruct_brep = DeconstructBrep(Brep=isotrim)  # -> Faces, Edges, Vertices
area_2 = Area(Geometry=deconstruct_brep.Faces)  # -> Area, Centroid
divide_surface = DivideSurface(Surface=surface, UCount=number_slider_2, VCount=number_slider_2)  # -> Points, Normals, Parameters
surface_closest_point = SurfaceClosestPoint(Point=area_2.Centroid, Surface=deconstruct_brep.Faces)  # -> Point, UVPoint, Distance
evaluate_surface = EvaluateSurface(Surface=deconstruct_brep.Faces, Point=surface_closest_point.UVPoint)  # -> Point, Normal, UDirection, VDirection, Frame
vector_display = VectorDisplay(Anchor=divide_surface.Points, Vector=divide_surface.Normals)
amplitude = Amplitude(Vector=divide_surface.Normals, Amplitude=Slider(0.781, range=0.001..2))
vector_display_2 = VectorDisplay(Anchor=evaluate_surface.Point, Vector=evaluate_surface.Normal)
addition = Addition(A=number_slider_2, B=Slider(1, range=0..10))
move = Move(Geometry=divide_surface.Points, Motion=amplitude)  # -> flatten(Geometry), Transform
surface_from_points = SurfaceFromPoints(Points=move.Geometry, UCount=addition, Interpolate=False)
mesh_frompoints = MeshFromPoints(Points=move.Geometry, UDirection=addition, VDirection=addition)
deconstruct_brep_2 = DeconstructBrep(Brep=surface)  # -> Faces, graft(Edges), Vertices
deconstruct_brep_3 = DeconstructBrep(Brep=surface_from_points)  # -> Faces, graft(Edges), Vertices
loft = Loft(
    Curves=[deconstruct_brep_3.Edges, deconstruct_brep_2.Edges],
    Options={Adjust=False, Closed=False, LoftEnds=0, LoftSimp=0, LoftType=0, Rebuild=10, Refit=0.01})  # -> flatten(Loft)
brep_join = BrepJoin(Breps=[surface_from_points, loft, surface])  # -> Breps, Closed
