# Grasshopper definition 053_WICKERSON.gh (Grasshopper 1.0.7)
# Copyright: Wickerson Studios
# plug-ins: Bifocals, MeshEdit Components

spin_force = SpinForce(Plane=PlaneXY(0, 0, 0), Strength=1, Radius=5, Decay=2)

field_line = FieldLine(Steps=1000, Accuracy=0.1, Method=3)

# ----
# Wickerson's Favorite .gh Scripts
# from WICKERSON
point_charge = PointCharge(Charge=1, Decay=2)

merge_fields = MergeFields()

perpendicular_display = PerpendicularDisplay(Samples=1000, PositiveColour=RGB(255, 255, 255), NegativeColour=RGB(0, 0, 0))
direction_display = DirectionDisplay(Samples=1000)
evaluate_field = EvaluateField()  # -> Tensor, Strength
scalar_display = ScalarDisplay(Samples=1000)
vector_force = VectorForce()
break_field = BreakField()
line_charge = LineCharge(Charge=1)
tensor_display = TensorDisplay(Samples=1000)

number_slider = Slider(10, range=0..10)
construct_point = ConstructPoint(XCoordinate=0, YCoordinate=0, ZCoordinate=0)
construct_point_2 = ConstructPoint(XCoordinate=number_slider, YCoordinate=number_slider, ZCoordinate=number_slider)
vector_2pt = Vector2Pt(PointA=construct_point, PointB=construct_point_2, Unitize=False)  # -> Vector, Length
vector_display = VectorDisplay(Anchor=construct_point, Vector=vector_2pt.Vector)

number_slider_2 = Slider(73, range=0..100)
number_slider_3 = Slider(63, range=0..100)
square = Square(Plane=PlaneXY(0, 0, 0), Size=Slider(2, range=0..10), ExtentX=number_slider_2, ExtentY=number_slider_2)  # -> Cells, Points
construct_point_3 = ConstructPoint(XCoordinate=number_slider_3, YCoordinate=number_slider_3, ZCoordinate=number_slider_3)
area = Area(Geometry=square.Cells)  # -> Area, Centroid
vector_2pt_2 = Vector2Pt(PointA=construct_point_3, PointB=area.Centroid, Unitize=False)  # -> Vector, Length
negative = Negative(Value=Slider(27, range=0..100))
vector_display_2 = VectorDisplay(Anchor=construct_point_3, Vector=vector_2pt_2.Vector)
line_sdl = LineSDL(Start=area.Centroid, Direction=vector_2pt_2.Vector, Length=negative)
end_points = EndPoints(Curve=line_sdl)  # -> flatten(Start), flatten(End)
surface_from_points = SurfaceFromPoints(Points=end_points.End, UCount=number_slider_2, Interpolate=False)

circle = Circle(Plane=PlaneXY(0, 0, 0), Radius=Slider(68, range=0..100))
boundary_surfaces = BoundarySurfaces(Edges=circle)
number_slider_4 = Slider(1, range=0..1)
divide_surface = DivideSurface(Surface=boundary_surfaces, UCount=10, VCount=10)  # -> Points, Normals, Parameters

number_slider_5 = Slider(37, range=0..100)
negative_2 = Negative(Value=number_slider_5)
construct_domain = ConstructDomain(DomainStart=number_slider_5, DomainEnd=negative_2)
circle_2 = Circle(Plane=PlaneXY(0, 0, 0), Radius=Slider(21, range=0..100))
divide_curve = DivideCurve(Curve=circle_2, Count=Slider(2, range=0..10), Kinks=False)  # -> Points, Tangents, Parameters
rectangle = Rectangle(Plane=PlaneXY(0, 0, 0), XSize=construct_domain, YSize=construct_domain, Radius=0)  # -> Rectangle, Length
point_charge_2 = PointCharge(Point=divide_curve.Points, Charge=Slider(1, range=0..1), Decay=Slider(1.5, range=0..10), Bounds=rectangle.Rectangle)
spin_force_2 = SpinForce(
    Plane=divide_curve.Points,
    Strength=Slider(0.9, range=0..1),
    Radius=Slider(5.7, range=0..10),
    Decay=Slider(2, range=0..10),
    Bounds=rectangle.Rectangle)
circle_3 = Circle(Plane=divide_curve.Points, Radius=Slider(5, range=0..10))
merge_fields_2 = MergeFields(Fields=[point_charge_2, spin_force_2])
divide_curve_2 = DivideCurve(Curve=circle_3, Count=Slider(20, range=0..100), Kinks=False)  # -> Points, Tangents, Parameters
field_line_2 = FieldLine(Field=merge_fields_2, Point=divide_curve_2.Points, Steps=1000, Accuracy=0.1, Method=3)

number_slider_6 = Slider(33, range=0..100)
negative_3 = Negative(Value=number_slider_6)
division = Division(A=number_slider_6, B=Slider(2, range=0..10))
construct_domain_2 = ConstructDomain(DomainStart=number_slider_6, DomainEnd=negative_3)
circle_4 = Circle(Plane=PlaneXY(0, 0, 0), Radius=division)
divide_curve_3 = DivideCurve(Curve=circle_4, Count=Slider(2, range=0..10), Kinks=False)  # -> Points, Tangents, Parameters
rectangle_2 = Rectangle(Plane=PlaneXY(0, 0, 0), XSize=construct_domain_2, YSize=construct_domain_2, Radius=0)  # -> Rectangle, Length
point_charge_3 = PointCharge(Point=divide_curve_3.Points, Charge=Slider(1, range=0..1), Decay=Slider(1.5, range=0..10), Bounds=rectangle_2.Rectangle)
spin_force_3 = SpinForce(
    Plane=divide_curve_3.Points,
    Strength=Slider(0.9, range=0..1),
    Radius=Slider(5.7, range=0..10),
    Decay=Slider(2, range=0..10),
    Bounds=rectangle_2.Rectangle)
circle_5 = Circle(Plane=divide_curve_3.Points, Radius=Slider(5, range=0..10))
merge_fields_3 = MergeFields(Fields=[point_charge_3, spin_force_3])
divide_curve_4 = DivideCurve(Curve=circle_5, Count=Slider(20, range=0..100), Kinks=False)  # -> Points, Tangents, Parameters
field_line_3 = FieldLine(Field=merge_fields_3, Point=divide_curve_4.Points, Steps=1000, Accuracy=0.1, Method=3)  # -> flatten(Curve)
list_length = ListLength(List=field_line_3)
construct_domain_3 = ConstructDomain(DomainStart=0, DomainEnd=Slider(34, range=0..100))
range = Range(Domain=construct_domain_3, Steps=list_length)
unit_z = UnitZ(Factor=range)
move = Move(Geometry=field_line_3, Motion=unit_z)  # -> Geometry, Transform
divide_curve_5 = DivideCurve(Curve=move.Geometry, Count=10, Kinks=False)  # -> flatten(Points), Tangents, Parameters
addition = Addition(A=list_length, B=Slider(1, range=0..1))
surface_from_points_2 = SurfaceFromPoints(Points=divide_curve_5.Points, UCount=addition, Interpolate=False)

point_charge_4 = PointCharge(Point=Point(-67, 0, 0), Charge=Slider(4, range=-10..10), Decay=number_slider_4)
point_charge_5 = PointCharge(Point=Point(67, 0, 0), Charge=Slider(6, range=-10..10), Decay=number_slider_4)

point_charge_6 = PointCharge(Point=Point(-67, 0, 0), Charge=Slider(-9, range=-10..10), Decay=number_slider_4)
point_charge_7 = PointCharge(Point=Point(67, 0, 0), Charge=Slider(5, range=-10..10), Decay=number_slider_4)

merge_fields_4 = MergeFields(Fields=[point_charge_6, point_charge_7, point_charge_4, point_charge_5])

field_line_4 = FieldLine(Field=merge_fields_4, Point=divide_surface.Points, Steps=Slider(4503, range=0..10000), Accuracy=0.1, Method=3)

number_slider_7 = Slider(93, range=0..100)
plane_surface = PlaneSurface(Plane=PlaneXY(0, 0, 0), XSize=number_slider_7, YSize=number_slider_7)
surface = Surface(surface_from_points)
dimensions = Dimensions(Surface=surface)  # -> UDimension, VDimension
number_slider_8 = Slider(14, range=0..50)
md_slider = MDSlider(
    SliderMode=0,
    slider_value=Point(0.4141400965, 0.3752348365, 0.5),
    x_domain=Domain(0, 1),
    y_domain=Domain(0, 1),
    z_domain=Domain(0, 1))
division_2 = Division(A=dimensions.UDimension, B=dimensions.VDimension)
area_2 = Area(Geometry=surface)  # -> Area, Centroid
multiplication = Multiplication(A=division_2, B=number_slider_8)
integer = Integer(multiplication)
scale = Scale(Geometry=surface, Center=area_2.Centroid, Factor=Slider(1.55, range=0..5))  # -> Geometry, Transform
divide_surface_2 = DivideSurface(Surface=surface, UCount=integer, VCount=number_slider_8)  # -> flatten(Points), Normals, Parameters
expression = Expression(x=integer, Expression="x+1")
evaluate_surface = EvaluateSurface(Surface=reparameterize(scale.Geometry), Point=md_slider)  # -> Point, Normal, UDirection, VDirection, Frame
distance = Distance(PointA=graft(evaluate_surface.Point), PointB=divide_surface_2.Points)
expression_2 = Expression(w=graft(Slider(0.106, range=0..2)), t=distance, Expression="sin(w*t)^2")
multiplication_2 = Multiplication(A=Slider(14.83, range=0..20), B=expression_2)
unit_z_2 = UnitZ(Factor=multiplication_2)
move_2 = Move(Geometry=divide_surface_2.Points, Motion=unit_z_2)  # -> Geometry, Transform
surface_from_points_3 = SurfaceFromPoints(Points=move_2.Geometry, UCount=expression, Interpolate=False)

number_slider_9 = Slider(93, range=0..100)
plane_surface_2 = PlaneSurface(Plane=PlaneXY(0, 0, 0), XSize=number_slider_9, YSize=number_slider_9)
surface_2 = Surface(surface_from_points_2)
dimensions_2 = Dimensions(Surface=surface_2)  # -> UDimension, VDimension
number_slider_10 = Slider(14, range=0..50)
md_slider_2 = MDSlider(
    SliderMode=0,
    slider_value=Point(0.4141400965, 0.3752348365, 0.5),
    x_domain=Domain(0, 1),
    y_domain=Domain(0, 1),
    z_domain=Domain(0, 1))
division_3 = Division(A=dimensions_2.UDimension, B=dimensions_2.VDimension)
area_3 = Area(Geometry=surface_2)  # -> Area, Centroid
multiplication_3 = Multiplication(A=division_3, B=number_slider_10)
integer_2 = Integer(multiplication_3)
scale_2 = Scale(Geometry=surface_2, Center=area_3.Centroid, Factor=Slider(1.55, range=0..5))  # -> Geometry, Transform
divide_surface_3 = DivideSurface(Surface=surface_2, UCount=integer_2, VCount=number_slider_10)  # -> flatten(Points), Normals, Parameters
expression_3 = Expression(x=integer_2, Expression="x+1")
evaluate_surface_2 = EvaluateSurface(Surface=reparameterize(scale_2.Geometry), Point=md_slider_2)  # -> Point, Normal, UDirection, VDirection, Frame
distance_2 = Distance(PointA=graft(evaluate_surface_2.Point), PointB=divide_surface_3.Points)
expression_4 = Expression(w=graft(Slider(0.106, range=0..2)), t=distance_2, Expression="sin(w*t)^2")
multiplication_4 = Multiplication(A=Slider(14.83, range=0..20), B=expression_4)
unit_z_3 = UnitZ(Factor=multiplication_4)
move_3 = Move(Geometry=divide_surface_3.Points, Motion=unit_z_3)  # -> Geometry, Transform
surface_from_points_4 = SurfaceFromPoints(Points=move_3.Geometry, UCount=expression_3, Interpolate=False)
unit_z_4 = UnitZ(Factor=Slider(2, range=0..10))
extrude = Extrude(Base=surface_from_points_4, Direction=unit_z_4)

flip_matrix = FlipMatrix(Data=expression_2)
mass_multiplication = MassMultiplication(Input=flip_matrix)  # -> flatten(Result), PartialResults
mass_addition = MassAddition(Input=flip_matrix)  # -> flatten(Result), PartialResults

number_slider_11 = Slider(5, range=0..100)
surface_3 = Surface(surface_from_points_3)
divide_surface_4 = DivideSurface(Surface=surface_3, UCount=number_slider_11, VCount=number_slider_11)  # -> Points, Normals, Parameters
amplitude = Amplitude(Vector=divide_surface_4.Normals, Amplitude=Slider(7.534, range=0.001..12))
vector_display_3 = VectorDisplay(Anchor=divide_surface_4.Points, Vector=divide_surface_4.Normals)
move_4 = Move(Geometry=divide_surface_4.Points, Motion=amplitude)  # -> flatten(Geometry), Transform
expression_5 = Expression(x=number_slider_11, Expression="x+1")
surface_from_points_5 = SurfaceFromPoints(Points=move_4.Geometry, UCount=expression_5, Interpolate=False)
mesh_frompoints = MeshFromPoints(Points=move_4.Geometry, UDirection=expression_5, VDirection=expression_5)
deconstruct_brep = DeconstructBrep(Brep=surface_from_points_5)  # -> Faces, graft(Edges), Vertices
deconstruct_brep_2 = DeconstructBrep(Brep=surface)  # -> Faces, graft(Edges), Vertices
geometry = Geometry(deconstruct_brep_2.Edges)
merge = Merge(Data1=deconstruct_brep.Edges, Data2=geometry)
loft = Loft(Curves=merge, Options={Adjust=False, Closed=False, LoftEnds=0, LoftSimp=0, LoftType=0, Rebuild=10, Refit=0.01})  # -> flatten(Loft)
geometry_2 = Geometry(surface)
merge_2 = Merge(Data1=surface_from_points_5, Data2=loft, Data3=geometry_2)
brep_join = BrepJoin(Breps=merge_2)  # -> Breps, Closed

flip_matrix_2 = FlipMatrix(Data=expression_4)
mass_multiplication_2 = MassMultiplication(Input=flip_matrix_2)  # -> flatten(Result), PartialResults
mass_addition_2 = MassAddition(Input=flip_matrix_2)  # -> flatten(Result), PartialResults

circle_6 = Circle(Plane=PlaneXY(0, 0, 0), Radius=Slider(61, range=0..100))
boundary_surfaces_2 = BoundarySurfaces(Edges=circle_6)
point = Point(Point(14, 48, 0))
point_2 = Point(Point(26, -24, 0))
point_3 = Point(Point(-39, -13, 0))
populate_geometry = PopulateGeometry(Geometry=boundary_surfaces_2, Count=100, Seed=1)  # -> flatten(Population)
populate_3d = Populate3D(Region=boundary_surfaces_2, Count=100, Seed=1)
closest_point = ClosestPoint(Point=populate_geometry, Cloud=[point_3, point, point_2])  # -> ClosestPoint, CPIndex, Distance
multiplication_5 = Multiplication(A=closest_point.Distance, B=Slider(100, range=0..100))

spin_force_4 = SpinForce(Plane=point_3, Strength=1, Radius=Slider(20, range=0..100), Decay=2)
spin_force_5 = SpinForce(Plane=point, Strength=1, Radius=Slider(42.15, range=0..100), Decay=2)
spin_force_6 = SpinForce(Plane=point_2, Strength=1, Radius=Slider(43.45, range=0..100), Decay=2)

merge_fields_5 = MergeFields(Fields=[spin_force_4, spin_force_5, spin_force_6])
field_line_5 = FieldLine(Field=merge_fields_5, Point=populate_geometry, Steps=multiplication_5, Accuracy=0.1, Method=3)

circle_7 = Circle(Plane=PlaneXY(0, 0, 0), Radius=Slider(20, range=0..100))
boundary_surfaces_3 = BoundarySurfaces(Edges=circle_7)
point_4 = Point(Point(14, 48, 0))
point_5 = Point(Point(26, -24, 0))
point_6 = Point(Point(-39, -13, 0))
populate_geometry_2 = PopulateGeometry(Geometry=boundary_surfaces_3, Count=100, Seed=1)  # -> flatten(Population)
populate_3d_2 = Populate3D(Region=boundary_surfaces_3, Count=100, Seed=1)
closest_point_2 = ClosestPoint(Point=populate_geometry_2, Cloud=[point_6, point_4, point_5])  # -> ClosestPoint, CPIndex, Distance
multiplication_6 = Multiplication(A=closest_point_2.Distance, B=Slider(10, range=0..10))

spin_force_7 = SpinForce(Plane=point_6, Strength=1, Radius=Slider(100, range=0..100), Decay=2)
spin_force_8 = SpinForce(Plane=point_4, Strength=1, Radius=Slider(42.15, range=0..100), Decay=2)
spin_force_9 = SpinForce(Plane=point_5, Strength=1, Radius=Slider(43.45, range=0..100), Decay=2)

merge_fields_6 = MergeFields(Fields=[spin_force_7, spin_force_8, spin_force_9])
field_line_6 = FieldLine(Field=merge_fields_6, Point=populate_geometry_2, Steps=multiplication_6, Accuracy=0.1, Method=3)

list_length_2 = ListLength(List=field_line_6)
expression_6 = Expression(x=list_length_2, Expression="x-1")
construct_domain_4 = ConstructDomain(DomainStart=0, DomainEnd=Slider(12.33, range=0..100))
range_2 = Range(Domain=construct_domain_4, Steps=expression_6)
jitter = Jitter(List=range_2, Jitter=1, Seed=2)  # -> Values, Indices
unit_z_5 = UnitZ(Factor=jitter.Values)
number_slider_12 = Slider(0.328, range=0..1)
move_5 = Move(Geometry=field_line_6, Motion=unit_z_5)  # -> flatten(Geometry), Transform
list_length_3 = ListLength(List=move_5.Geometry)

number_slider_13 = Slider(1.439, range=0..2)
md_slider_3 = MDSlider(
    SliderMode=0,
    slider_value=Point(0.712735432, 0.3769590796, 0.5),
    x_domain=Domain(0, 1),
    y_domain=Domain(0, 1),
    z_domain=Domain(0, 1))
surface_4 = Surface(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)

number_slider_14 = Slider(21, range=0..100)
surface_5 = Surface(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)
dimensions_3 = Dimensions(Surface=surface_5)  # -> UDimension, VDimension
division_4 = Division(A=dimensions_3.UDimension, B=dimensions_3.VDimension)
multiplication_7 = Multiplication(A=division_4, B=number_slider_14)

area_4 = Area(Geometry=surface_5)  # -> Area, Centroid
integer_3 = Integer(multiplication_7)
scale_3 = Scale(Geometry=surface_5, Center=area_4.Centroid, Factor=Slider(2.66, range=0..5))  # -> Geometry, Transform
expression_7 = Expression(x=integer_3, Expression="x+1")
evaluate_surface_3 = EvaluateSurface(Surface=reparameterize(scale_3.Geometry), Point=md_slider_3)  # -> Point, Normal, UDirection, VDirection, Frame

divide_surface_5 = DivideSurface(Surface=surface_5, UCount=integer_3, VCount=number_slider_14)  # -> flatten(Points), Normals, Parameters

distance_3 = Distance(PointA=evaluate_surface_3.Point, PointB=divide_surface_5.Points)
expression_8 = Expression(w=graft(number_slider_13), t=distance_3, k=Slider(-7, range=-10..10), Expression="sin(w*t + k*sin(w*t))")
expression_9 = Expression(w=graft(number_slider_13), t=distance_3, Expression="sin(w*t)^2")
multiplication_8 = Multiplication(A=Slider(5.84, range=0..10), B=expression_8)
unit_z_6 = UnitZ(Factor=multiplication_8)
move_6 = Move(Geometry=divide_surface_5.Points, Motion=unit_z_6)  # -> Geometry, Transform
surface_from_points_6 = SurfaceFromPoints(Points=move_6.Geometry, UCount=expression_7, Interpolate=False)

construct_domain_5 = ConstructDomain(DomainStart=0, DomainEnd=Slider(2, range=0..100))
expression_10 = Expression(x=number_slider_12, w=Slider(5, range=0..10), Expression="x*w*sin(2)")
range_3 = Range(Domain=construct_domain_5, Steps=list_length_3)
multiplication_9 = Multiplication(A=expression_10, B=range_3)

pi = Pi(Factor=multiplication_9)
rotate_3d = Rotate3D(Geometry=move_5.Geometry, Angle=multiplication_9, Center=Point(0, 0, 0), Axis=Vector(0, 0, 1))  # -> Geometry, Transform
rotate_axis = RotateAxis(Geometry=rotate_3d.Geometry, Angle=pi, Axis=Line((0, 0, 0), (10, 0, 0)))  # -> Geometry, Transform
pipe = Pipe(Curve=rotate_axis.Geometry, Radius=number_slider_12, Caps=Toggle(True))

end_points_2 = EndPoints(Curve=rotate_axis.Geometry)  # -> Start, End
mesh_sphere = MeshSphere(Base=end_points_2.Start, Radius=multiplication_9, UCount=10, VCount=20)
