# Grasshopper definition 054_WICKERSON.gh (Grasshopper 1.0.7)
# plug-ins: Bifocals

polygon = Polygon(Plane=PlaneXY(0, 0, 0), Radius=Slider(3, range=0..100), Segments=Slider(5, range=0..10), FilletRadius=0)  # -> Polygon, Length
polar_array = PolarArray(Geometry=polygon.Polygon, Plane=PlaneXY(0, 0, 0), Count=Slider(2, range=0..10), Angle=6.283185307)  # -> Geometry, Transform
region_union = RegionUnion(Curves=polar_array.Geometry)
curve = Curve(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)
curve_2 = Curve(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)
curve_3 = Curve(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)
curve_4 = Curve(<curve referenced from the Rhino model>)
curve_5 = Curve(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)
curve_6 = Curve(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)
curve_7 = Curve(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)
curve_8 = Curve(<curve referenced from the Rhino model>)
curve_9 = Curve(<curve referenced from the Rhino model>)
curve_10 = Curve(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)
curve_11 = Curve([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])
list_item = ListItem(List=curve_11, Index=Slider(11, range=0..20), Wrap=True)
geometry = Geometry(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)
stream_filter = StreamFilter(
    Gate=Slider(5, range=0..11),
    Stream0=geometry,
    Stream1=curve,
    Stream2=curve_2,
    Stream3=curve_3,
    Stream4=curve_4,
    Stream5=curve_5,
    Stream6=curve_6,
    Stream7=curve_7,
    Stream8=curve_8,
    Stream9=curve_9,
    Stream10=curve_10,
    Stream11=list_item)
rebuild_curve = RebuildCurve(Curve=stream_filter, Degree="3", Count=Slider(100, range=0..100), Tangents=False)
# Wickerson's Favorite .gh Scripts
# from WICKERSON
number_slider = Slider(9, range=0..100)
boundary_surfaces = BoundarySurfaces(Edges=rebuild_curve)
divide_curve = DivideCurve(Curve=rebuild_curve, Count="2", Kinks=False)  # -> Points, Tangents, Parameters
divide_domain² = DivideDomain²(Domain=boundary_surfaces, UCount=number_slider, VCount=number_slider)
dispatch = Dispatch(List=divide_curve.Points, DispatchPattern=[True, False])  # -> ListA, ListB
isotrim = Isotrim(Surface=boundary_surfaces, Domain=divide_domain²)
distance = Distance(PointA=dispatch.ListA, PointB=dispatch.ListB)
area = Area(Geometry=isotrim)  # -> Area, Centroid
area_2 = Area(Geometry=boundary_surfaces)  # -> Area, Centroid
panel = Panel("10")
multiplication = Multiplication(A=distance, B=Slider(1.06, range=1..2))
distance_2 = Distance(PointA=area_2.Centroid, PointB=area.Centroid)
subtraction = Subtraction(A=multiplication, B=distance_2)
multiplication_2 = Multiplication(A=subtraction, B=Slider(0.2, range=0..1))
unit_z = UnitZ(Factor=multiplication_2)
move = Move(Geometry=area.Centroid, Motion=unit_z)  # -> Geometry, Transform
surface_from_points = SurfaceFromPoints(Points=move.Geometry, UCount=number_slider, Interpolate=False)
deconstruct_brep = DeconstructBrep(Brep=boundary_surfaces)  # -> Faces, Edges, Vertices
scale = Scale(Geometry=surface_from_points, Center=area_2.Centroid, Factor=Slider(1.22, range=0..10))  # -> Geometry, Transform
project = Project(Curve=deconstruct_brep.Edges, Brep=scale.Geometry, Direction=Vector(0, 0, 1))
surface_split = SurfaceSplit(Surface=scale.Geometry, Curves=project)
dispatch_2 = Dispatch(List=surface_split, DispatchPattern=[True, False])  # -> ListA, ListB
loft = Loft(
    Curves=flatten([project, deconstruct_brep.Edges]),
    Options={Adjust=False, Closed=False, LoftEnds=0, LoftSimp=0, LoftType=0, Rebuild=10, Refit=0.01})
surface = Surface(dispatch_2.ListB)
merge = Merge(Data1=surface, Data2=loft, Data3=boundary_surfaces)  # -> flatten(Result)
brep_join = BrepJoin(Breps=merge)  # -> Breps, Closed
