# Grasshopper definition 055_WICKERSON.gh (Grasshopper 1.0.7)
# Copyright: Wickerson Studios
# plug-ins: Bifocals

# ----
# Wickerson's Favorite .gh Scripts
# from WICKERSON
# Geometry
# Open Grasshopper in Rhino Command Line
# Drag in GhPython Script node from Maths.Script
number_slider = Slider(6, range=0..10)
number_slider_2 = Slider(10, range=0..12)

ghpython_script = GhPythonScript(start=number_slider, stop=number_slider_2, step=Slider(3, range=0..10), Amplifier=Slider(10, range=0.01..10))  # -> out, points_Output; inputs start: Int32, stop: Int32, step: Int32
# ---------- ghpython_script: Python ----------
import Rhino.Geometry as rg
import math

points = []

for i in range(start,stop,step):
    point = rg.Point3d(i, i*i, math.log10(i))
    points.append(point)
    point = rg.Point3d(i, i*i, math.log(i))
    points.append(point)
    point = rg.Point3d(i, i*i, math.log(i*Amplifier**2))
    points.append(point)


points_Output = points
# ---------- end ghpython_script ----------
expression = Expression(Expression="Format(\"{0}, {1}\", x, y)")
evaluate = Evaluate()
interpolate = Interpolate(Vertices=ghpython_script.points_Output, Degree=3, Periodic=False, KnotStyle=1)  # -> Curve, Length, Domain
panel = Panel(ghpython_script.points_Output)
polar_array = PolarArray(Geometry=interpolate.Curve, Plane=PlaneXY(0, 0, 0), Count=number_slider_2, Angle=6.283185307)  # -> Geometry, Transform
dispatch = Dispatch(List=polar_array.Geometry, DispatchPattern=[True, False])  # -> ListA, ListB
unit_z = UnitZ(Factor=number_slider_2)
move = Move(Geometry=dispatch.ListA, Motion=unit_z)  # -> Geometry, Transform
loft_options = LoftOptions(Closed=Toggle(True), Adjust=False, Rebuild=0, Refit=0, Type=0)
weave = Weave(Pattern=[0, 1], Stream0=move.Geometry, Stream1=dispatch.ListB, NullGaps=False)
loft = Loft(Curves=weave, Options=loft_options)

number_slider_3 = Slider(29, range=0..100)

surface = Surface(loft)
divide_surface = DivideSurface(Surface=surface, UCount=number_slider_3, VCount=number_slider_3)  # -> Points, Normals, Parameters
amplitude = Amplitude(Vector=divide_surface.Normals, Amplitude=Slider(12, range=0.001..12))
move_2 = Move(Geometry=divide_surface.Points, Motion=amplitude)  # -> flatten(Geometry), Transform
expression_2 = Expression(x=number_slider_3, Expression="x+1")
vector_display = VectorDisplay(Anchor=divide_surface.Points, Vector=divide_surface.Normals)
surface_from_points = SurfaceFromPoints(Points=move_2.Geometry, UCount=expression_2, Interpolate=False)
deconstruct_brep = DeconstructBrep(Brep=surface)  # -> Faces, graft(Edges), Vertices
deconstruct_brep_2 = DeconstructBrep(Brep=surface_from_points)  # -> Faces, graft(Edges), Vertices
loft_2 = Loft(
    Curves=[deconstruct_brep_2.Edges, deconstruct_brep.Edges],
    Options={Adjust=False, Closed=False, LoftEnds=0, LoftSimp=0, LoftType=0, Rebuild=10, Refit=0.01})  # -> flatten(Loft)
list_item = ListItem(List=flatten(deconstruct_brep_2.Edges), Index="0", Wrap=True)  # -> Item, Item1, Item2
list_item_2 = ListItem(List=flatten(deconstruct_brep.Edges), Index="0", Wrap=True)  # -> Item, Item1, Item2
merge = Merge(Data1=surface_from_points, Data2=loft_2, Data3=surface)
curve = Curve(list_item.Item2)
curve_2 = Curve(list_item_2.Item2)
curve_3 = Curve(list_item.Item)
curve_4 = Curve(list_item_2.Item)
brep_join = BrepJoin(Breps=merge)  # -> Breps, Closed
loft_3 = Loft(
    Curves=[curve_3, curve_4],
    Options={Adjust=False, Closed=False, LoftEnds=0, LoftSimp=0, LoftType=0, Rebuild=10, Refit=0.01})
loft_4 = Loft(
    Curves=[curve, curve_2],
    Options={Adjust=False, Closed=False, LoftEnds=0, LoftSimp=0, LoftType=0, Rebuild=10, Refit=0.01})
merge_2 = Merge(Data1=brep_join.Breps, Data2=loft_4, Data3=loft_3)  # -> flatten(Result)
brep_join_2 = BrepJoin(Breps=merge_2)  # -> Breps, Closed
brep_join_3 = BrepJoin(Breps=merge_2)  # -> Breps, Closed
brep_join_4 = BrepJoin(Breps=merge_2)  # -> Breps, Closed
