# Grasshopper definition 056_WICKERSON.gh (Grasshopper 1.0.7)
# plug-ins: Bifocals

optional_seed_for_jitter_node = Slider(25, range=0..100)
# Wickerson's Favorite .gh Scripts
# from WICKERSON
# Parameters to Play with!
uv_point_count = Slider(24, range=0..100)
width = Slider(8, range=0..10)
height_map = Slider(1.58, range=0..2)
thickness_of_zinc = Slider(0.86, range=0..10)

# ----
# Optional Gene Pool
# for Dispatch Pattern
gene_pool = GenePool(
    Decimals=0,
    Maximum=1,
    Minimum=0,
    Value=[0.4993554207, 0.3710213901, 0.3489724455, 0.3696668201, 0.1242435477, 0.6296129597, 0.3397678241, 0.6562945413, 0.5175986637, 0.7160073168, 0.7196400099, 0.4640492264, 0.7501994636, 0.5269394911, 0.350875952, 0.1179931411, 0.212037637, 0.7281702811, 0.9215725101, 0.4639350504, 0.4192515916, 0.4793637821, 0.1462759572, 0.6795558895, 0.3692009227, 0.679618724, 0.1221239134, 0.3766570675, 0.7112995576, 0.2930767817])

rectangle = Rectangle(Plane=PlaneXY(0, 0, 0), XSize=uv_point_count, YSize=width, Radius=0)  # -> Rectangle, Length
divide_surface = DivideSurface(Surface=rectangle.Rectangle, UCount=uv_point_count, VCount=uv_point_count)  # -> flatten(Points), Normals, Parameters
construct_domain = ConstructDomain(DomainStart=0, DomainEnd=height_map)
dispatch = Dispatch(List=divide_surface.Points, DispatchPattern=gene_pool)  # -> ListA, ListB
surface_from_points = SurfaceFromPoints(Points=divide_surface.Points, UCount=expr("x+1", uv_point_count), Interpolate=False)
list_length = ListLength(List=dispatch.ListA)  # -> flatten(Length)
range = Range(Domain=construct_domain, Steps=expr("x-1", list_length))
unit_z = UnitZ(Factor=range)
unit_z_2 = UnitZ(Factor=thickness_of_zinc)

# ----
# Optional Jitter
# Node for
# SEED
jitter = Jitter(List=unit_z, Jitter=1, Seed=optional_seed_for_jitter_node)  # -> Values, Indices

point_deform = PointDeform(Geometry=surface_from_points, Points=dispatch.ListA, Motion=unit_z)

# ----
# Bake me in to RHINO!
extrude = Extrude(Base=point_deform, Direction=unit_z_2)
