# Grasshopper definition 057_WICKERSON.gh (Grasshopper 1.0.7)
# plug-ins: Bifocals

# Wickerson's Favorite .gh Scripts
# from WICKERSON
number_slider = Slider(19, range=0..100)
number_slider_2 = Slider(2, range=0..10)
number_slider_3 = Slider(9, range=1..11)
rectangular = Rectangular(Plane=PlaneXY(0, 0, 0), SizeX=number_slider, SizeY=number_slider, ExtentX=number_slider_2, ExtentY=number_slider_2)  # -> Cells, Points
move = Move(Geometry=rectangular.Points, Motion=Vector(0, 0, 10))  # -> Geometry, Transform
unit_z = UnitZ(Factor=number_slider)
split_list = SplitList(List=move.Geometry, Index=Slider(1, range=0..10))  # -> ListA, ListB
move_2 = Move(Geometry=split_list.ListB, Motion=unit_z)  # -> Geometry, Transform
unit_y = UnitY(Factor=1)
unit_x = UnitX(Factor=1)
pi = Pi(Factor=Slider(1.4, range=0..2))
split_list_2 = SplitList(List=move_2.Geometry, Index=Slider(1, range=0..10))  # -> ListA, ListB
vector_xyz = VectorXYZ(XComponent=unit_x, YComponent=unit_y, ZComponent=0)  # -> Vector, Length
move_3 = Move(Geometry=split_list_2.ListB, Motion=unit_z)  # -> Geometry, Transform
polar_array = PolarArray(Geometry=move_3.Geometry, Plane=vector_xyz.Vector, Count=number_slider_3, Angle=6.283185307)  # -> Geometry, Transform
split_list_3 = SplitList(List=move_3.Geometry, Index=Slider(1, range=0..10))  # -> ListA, ListB
explode_tree = ExplodeTree(Data=polar_array.Geometry)  # -> _000000, _001000, _002000
unit_y_2 = UnitY(Factor=1)
unit_x_2 = UnitX(Factor=1)
unit_z_2 = UnitZ(Factor=1)
unit_x_3 = UnitX(Factor=1)
unit_z_3 = UnitZ(Factor=1)
unit_y_3 = UnitY(Factor=1)
line = Line(StartPoint=explode_tree._000000, EndPoint=explode_tree._001000)  # -> graft(Line)
line_2 = Line(StartPoint=explode_tree._001000, EndPoint=explode_tree._002000)  # -> graft(Line)
merge = Merge(Data1=split_list.ListB, Data2=split_list_2.ListB, Data3=split_list_3.ListB, Data4=rectangular.Points)
pi_2 = Pi(Factor=Slider(0.33, range=0.01..1.99))
center_box = CenterBox(Base=merge, X=1, Y=1, Z=number_slider)
end_points = EndPoints(Curve=line)  # -> Start, End
end_points_2 = EndPoints(Curve=line_2)  # -> Start, End
rotate_3d = Rotate3D(Geometry=center_box, Angle=pi, Center=merge, Axis=unit_y)  # -> Geometry, Transform
rotate_3d_2 = Rotate3D(Geometry=center_box, Angle=pi, Center=merge, Axis=unit_x)  # -> Geometry, Transform
rotate_3d_3 = Rotate3D(Geometry=line, Angle=pi_2, Center=end_points.End, Axis=unit_x_3)  # -> flatten(Geometry), Transform
rotate_3d_4 = Rotate3D(Geometry=line_2, Angle=pi_2, Center=end_points_2.Start, Axis=unit_y_2)  # -> flatten(Geometry), Transform
merge_2 = Merge(Data1=rotate_3d_2.Geometry, Data2=rotate_3d.Geometry, Data3=center_box)
loft = Loft(
    Curves=rotate_3d_3.Geometry,
    Options={Adjust=False, Closed=False, LoftEnds=0, LoftSimp=0, LoftType=0, Rebuild=10, Refit=0.01})
loft_2 = Loft(
    Curves=rotate_3d_4.Geometry,
    Options={Adjust=False, Closed=False, LoftEnds=0, LoftSimp=0, LoftType=0, Rebuild=10, Refit=0.01})
polar_array_2 = PolarArray(Geometry=merge_2, Plane=vector_xyz.Vector, Count=number_slider_3, Angle=6.283185307)  # -> Geometry, Transform
xy_plane = XYPlane(Origin=Point(0, 0, 0))
merge_3 = Merge(Data1=loft, Data2=loft_2)
mirror = Mirror(Geometry=polar_array_2.Geometry, Plane=xy_plane)  # -> Geometry, Transform
scale_nu = ScaleNU(
    Geometry=merge_3,
    Plane=PlaneXY(0, 0, 0),
    ScaleX=Slider(1.93, range=1..2),
    ScaleY=Slider(1.72, range=1..2),
    ScaleZ=Slider(1.03, range=1..2))  # -> Geometry, Transform
merge_4 = Merge(Data1=scale_nu.Geometry, Data2=polar_array_2.Geometry, Data3=mirror.Geometry)
